# Grasshopper definition Example01_SimpleGlulam.gh (Grasshopper 1.0.4)
# plug-ins: tasLam, tasCore

crv = Curve(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)
bits3 = Bitmask3(Bitmask3=4, NumBits=3)
panel = Panel("""centreline
lamella_count_width
id
height
frames""")
glulam = Glulam(Curve=crv, Width=80, Height=80, Flags=bits3)  # -> Glulam, Geometry
mesh = Mesh(glulam.Glulam)
geo = Geometry(glulam.Geometry)
brep = Brep(glulam.Glulam)
delam = Delaminate(Glulam=glulam.Glulam, Keys=panel)
panel_2 = Panel(delam)
